# Grasshopper definition PMV.gh (Grasshopper 1.0.7)

honeybee = Honeybee_Honeybee(defaultFolder="C:\ladybug")  # -> Vviiiiiiiiiizzz; plug-in component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
ladybug = Ladybug_Ladybug(defaultFolder="C:\ladybug")  # -> Vviiiiiiiiiizzz; plug-in component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

# ----
# Create HB Zones
interiorsurfaces = Geometry(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)
createhbsrfs = Honeybee_createHBSrfs(geometry=interiorsurfaces, EPBC="adiabatic")  # -> readMe, simplify(HBSurface); plug-in component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

exteriorwall = Geometry([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])
exteriorwindows = Geometry([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])
createhbsrfs_2 = Honeybee_createHBSrfs(geometry=exteriorwall)  # -> readMe, simplify(HBSurface); plug-in component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
addhbglz = Honeybee_addHBGlz(HBObj=createhbsrfs_2.HBSurface, childSurfaces=flatten(exteriorwindows))  # -> HBObjWGLZ; plug-in component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

createhbzones = Honeybee_createHBZones(
    name="Office",
    zoneProgram="Office::OpenOffice",
    HBSurfaces=flatten([createhbsrfs.HBSurface, addhbglz]),
    isConditioned=True)  # -> readMe, HBZone; plug-in component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

# ----
# Assign HVAC
hvacsystemslist = Honeybee_HVACSystemsList({"-1. Thermostat Only": -1, "0. Ideal Air Loads": 0, "1. PTAC | Residential": 1, "2. PTHP | Residential": 2, "3. Packaged Single Zone - AC": 3, "4. Packaged Single Zone - HP": 4, "5. Packaged VAV w/ Reheat": 5, "6. Packaged VAV w/ PFP Boxes": 6, "7. VAV w/ Reheat": 7, "8. VAV w/ PFP Boxes": 8, "9. Warm Air Furnace - Gas Fired": 9, "10.Warm Air Furnace - Electric": 10, "11.Fan Coil Units + DOAS": 11, "12.Active Chilled Beams + DOAS": 12, "13.Radiant Floors + DOAS": 13, "14.VRF + DOAS": 14}, selected="11.Fan Coil Units + DOAS")
hvacsystem = Honeybee_AssignHVACSystem(HBZones=flatten(createhbzones.HBZone), HVACSystems=hvacsystemslist)  # -> readMe, HBZones; plug-in component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
setepzonethresholds = Honeybee_SetEnergyPlusZoneThresholds(HBZones=hvacsystem.HBZones, coolingSetPt="24", coolingSetback="24", heatingSetPt="21", heatingSetback="21")  # -> readMe, HBZones; plug-in component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

# ----
# Energy Simulation
# Parameters
panel = Panel("https://www.energyplus.net/weather-download/north_and_central_america_wmo_region_4/USA/MA/USA_MA_Boston-Logan.Intl.AP.725090_TMY3/all")
toggle = BooleanToggle(True)
epoutput = Honeybee_GenerateEPOutput(zoneGainsAndLosses="False", zoneComfortMetrics=toggle, surfaceTempAnalysis=toggle)  # -> report, flatten(simulationOutputs); plug-in component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
epw_stat = Ladybug_OpenEPWAndSTATWeatherFiles(weatherFileURL=panel)  # -> epwFile, statFile; plug-in component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
importstat = Ladybug_ImportStat(statFile=epw_stat.statFile)  # -> readMe, ashraeClimateZone, koppenClimateZone, heatingDesignTemps, coolingDesignTemps, heatingDesignDay, coolingDesignDay, monthlyTauBeam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; plug-in component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

# ----
# Scroll Through Hours of the Day
hour_of_the_day = Slider(18, range=8..18)
# 1
toggle_2 = BooleanToggle(True)
geo = Geometry(setepzonethresholds.HBZones)
importepw = Ladybug_ImportEpw(epwFile=epw_stat.epwFile)  # -> readMe, latitude, location, dryBulbTemperature, dewPointTemperature, relativeHumidity, windSpeed, windDirection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; plug-in component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

subtraction = Subtraction(A="19", B="8")
series = Series(Start="8", Step=1, Count=subtraction)

# ----
# 2
toggle_3 = BooleanToggle(True)
comfortevalgeo = Geometry(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)

# ----
# Collect Opaque
# Geometry
decomposebytype = Honeybee_DecomposeBasedOnType(HBZone=setepzonethresholds.HBZones)  # -> walls, interiorWalls, airWalls, windows, interiorWindows, skylights, roofs, ceilings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; plug-in component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
geo_2 = Geometry([decomposebytype.walls, decomposebytype.interiorWalls, decomposebytype.ceilings, decomposebytype.floors])
join = BrepJoin(Breps=geo_2)  # -> Breps, Closed

python = GhPythonScript(a_period=importstat.extremeHotWeek)  # -> start_m, start_d, end_m, end_d; inputs a_period: list
# ---------- python: Python ----------
if a_period != []:
    start_m = a_period[0][0]
    start_d = a_period[0][1]
    end_m = a_period[1][0]
    end_d = a_period[1][1]
# ---------- end python ----------
analysisperiod = Ladybug_AnalysisPeriod(fromMonth=python.start_m, fromDay=python.start_d, fromHour="8", toMonth=python.end_m, toDay=python.end_d, toHour="18")  # -> readMe, analysisPeriod; plug-in component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

# ----
# Run Energy Simuation!
exporttoopenstudio = Honeybee_ExportToOpenStudio(
    epwWeatherFile=epw_stat.epwFile,
    analysisPeriod=analysisperiod.analysisPeriod,
    HBZones=flatten(setepzonethresholds.HBZones),
    simulationOutputs=flatten(epoutput.simulationOutputs),
    writeOSM=toggle_2,
    runSimulation=toggle_2,
    fileName="ComfortableOffice")  # -> readMe, osmFileAddress, idfFileAddress, resultFileAddress, eioFileAddress, rddFileAddress, htmlReport, studyFolder, model; plug-in component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
readepresult = Honeybee_ReadEPResult(resultFileAddress=exporttoopenstudio.resultFileAddress)  # -> port, port_2, port_3, port_4, port_5, port_6, port_7, port_8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; plug-in component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
readepsrfresult = Honeybee_ReadEPSurfaceResult(resultFileAddress=exporttoopenstudio.resultFileAddress)  # -> surfaceIndoorTemp, surfaceOutdoorTemp, port, port_2, port_3, port_4, port_5, port_6, port_7; plug-in component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

# ----
# Load Surface
# Temperatures
colorsurfaces = Honeybee_ColorSurfacesByEPResult(srfData=readepsrfresult.surfaceIndoorTemp, HBZones=flatten(geo), stepOfSimulation=series, runIt=toggle_3)  # -> readMe, srfColoredMesh, zoneWireFrame, legend, legendBasePt, analysisTitle, srfBreps, srfColors, srfValues, relevantSrfData; plug-in component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
# 3
toggle_4 = BooleanToggle(True)

# ----
# Calculate View Factors
panel_2 = Panel("0")
genmesh = Ladybug_GenerateMesh(testGeometry=comfortevalgeo, gridSize="0.5", distBaseSrf=panel_2, moveTestMesh=True)  # -> readMe, simplify(testPoints), simplify(ptsVectors), simplify(facesArea), simplify(mesh); plug-in component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
toggle_5 = BooleanToggle(True)
branch = TreeBranch(Tree=simplify(colorsurfaces.srfBreps), Path="0", MaintainPaths=True)
srfviewfactors = Ladybug_SurfaceViewAnalysis(testPtsOrPlanes=flatten(genmesh.testPoints), testSrfs=branch, parallel=toggle_5, runIt=toggle_4)  # -> readMe, srfViewFactors, viewVecSrfIndex, viewVectors, viewPatches, viewPatchBasePt; disabled; plug-in component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

srfviewfactors_2 = Ladybug_SurfaceViewAnalysis(testPtsOrPlanes=flatten(genmesh.testPoints), testSrfs=branch, parallel=toggle_5, runIt=toggle_4)  # -> readMe, srfViewFactors, viewVecSrfIndex, viewVectors, viewPatches, viewPatchBasePt; plug-in component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
# 4
toggle_6 = BooleanToggle(True)

subtraction_2 = Subtraction(A=hour_of_the_day, B="8")
branch_2 = TreeBranch(Tree=simplify(colorsurfaces.srfValues), Path=subtraction_2, MaintainPaths=True)
mrt = Ladybug_MRTCalculator(temperatures=branch_2, viewFactors=srfviewfactors_2.srfViewFactors)  # -> MRT; plug-in component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

# ----
# Account for Shortwave Solar
toggle_7 = BooleanToggle(False)
move = Move(Geometry=genmesh.testPoints, Motion="0,0,-0.8")  # -> Geometry, Transform
solaradjusttemperature = Ladybug_OutdoorSolarTemperatureAdjustor(
    location=importepw.location,
    cumSkyMtxOrDirNormRad=importepw.directNormalRadiation,
    diffuseHorizRad=importepw.diffuseHorizontalRadiation,
    baseTemperature="20",
    baseDryBulbOrMRT=toggle_7,
    bodyPosture="4",
    bodyLocation=move.Geometry,
    contextShading=flatten(join.Breps),
    windowTransmissivity="0.65",
    analysisPeriodOrHOY=analysisperiod.analysisPeriod,
    runIt=toggle_6)  # -> readMe, port, effectiveRadiantField, MRTDelta, solarAdjustedMRT, port_2, mannequinMesh, port_3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; plug-in component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
strnum = Ladybug_SeparateData(inputList=flatten(solaradjusttemperature.MRTDelta))  # -> numbers, strings; plug-in component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
item = ListItem(List=strnum.numbers, Index=subtraction_2, Wrap=True)  # -> flatten(Item)
addition = Addition(A=item, B=mrt)

strnum_2 = Ladybug_SeparateData(inputList=flatten(readepresult.relativeHumidity))  # -> numbers, strings; plug-in component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
# Calculate PMV Comfort
strnum_3 = Ladybug_SeparateData(inputList=flatten(readepresult.airTemperature))  # -> numbers, strings; plug-in component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
item_2 = ListItem(List=strnum_2.numbers, Index=hour_of_the_day, Wrap=True)
item_3 = ListItem(List=strnum_3.numbers, Index=hour_of_the_day, Wrap=True)

# ----
# 5
toggle_8 = BooleanToggle(True)
pmvcomfortcalculator = Ladybug_PMVComfortCalculator(
    dryBulbTemperature=item_3,
    meanRadiantTemperature=addition,
    relativeHumidity=item_2,
    metabolicRate="1.1",
    clothingLevel="0.6",
    calcBalanceTemperature=False,
    runIt=toggle_8)  # -> readMe, port, predictedMeanVote, percentPeopleDissatisfied, standardEffectiveTemperature, port_2, comfortableOrNot, percentOfTimeComfortable, port_3, balanceTemperature; plug-in component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
gradientlibrary = Ladybug_GradientLibrary(gradIndex="10")  # -> customColors; plug-in component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
mesh = Mesh(genmesh.mesh)
legendpar = Ladybug_LegendParameters(lowBound="0", highBound="3", customColors=flatten(gradientlibrary))  # -> legendPar; plug-in component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
recolormesh = Ladybug_RecolorMesh(
    analysisResult=pmvcomfortcalculator.predictedMeanVote,
    inputMesh=mesh,
    legendPar=legendpar,
    analysisTitle="Summer Comfort",
    legendTitle="PMV")  # -> readMe, newMesh, newLegend, legendBasePt, meshColors, legendColors; plug-in component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
c_script = CSharpScript(mesh=recolormesh.newMesh)  # -> base64Draco; inputs mesh: Mesh
# ---------- c_script: C# ----------
    var options = new Rhino.FileIO.DracoCompressionOptions();
    options.CompressionLevel = 5;
    options.IncludeTextureCoordinates = false;
    options.IncludeVertexColors = false;

    var compressed = Rhino.FileIO.DracoCompression.Compress(mesh, options);
    base64Draco = compressed.ToBase64String();
# ---------- end c_script ----------

# ---- group: RH_OUT:115:Mesh
txt = Text(c_script)
